# Dynamo graph class-assignment.dyn (Dynamo 2.0.2.6826)

# group: Get elements
categories = Categories(index=416)  # graph input
all_elements_of_category = ElementsOfCategory(Category=categories)

# group: Generate triples
instance_namespace = CodeBlock { "http://localhost:3000/duplex/arch/spaces/"; }
class_namespace = CodeBlock { ["bot", "https://w3id.org/bot#"]; }
class_ = CodeBlock { "bot:Space"; }
# note: [0]Instance namespace
# [1]Class namespace
# [2]Class
# [3]Elements
assign_class = Python(IN[0]=instance_namespace, IN[1]=class_namespace, IN[2]=class_, IN[3]=all_elements_of_category)
# ---------- assign_class.python (16 lines) ----------
#The inputs to this node will be stored as a list in the IN variables.
instNS = IN[0]
clPFX = IN[1][0]
clNS = IN[1][1]
cl = IN[2]
elements = IN[3]

# PREFIXES
str = "@prefix inst: <%s> .\n" % instNS
str+= "@prefix %s: <%s> .\n\n" % (clPFX, clNS)

# INSTANCES
for e in elements:
	str+= "inst:%s a %s .\n" % (e.UniqueId, cl)

OUT = str
# ----------------------------------------

watch = Watch(assign_class)

# group: Write to file
file_path = Filename("..\..\..\..\..\Downloads\test.ttl")
writeText = FileSystem.WriteText(filePath=file_path, text=watch)
