# Dynamo graph class-assignment_OPM-REST.dyn (Dynamo 2.0.2.6826)

# group: Get elements
categories = Categories(index=425)  # graph input
all_elements_of_category = ElementsOfCategory(Category=categories)

# group: Generate triples
instance_namespace = CodeBlock { "http://localhost:3000/duplex/arch/spaces/"; }
class_namespace = CodeBlock { ["bot", "https://w3id.org/bot#"]; }
class_ = CodeBlock { "bot:Space"; }
# note: [0]Instance namespace
# [1]Class namespace
# [2]Class
# [3]Elements
assign_class = Python(IN[0]=instance_namespace, IN[1]=class_namespace, IN[2]=class_, IN[3]=all_elements_of_category)
# ---------- assign_class.python (16 lines) ----------
#The inputs to this node will be stored as a list in the IN variables.
instNS = IN[0]
clPFX = IN[1][0]
clNS = IN[1][1]
cl = IN[2]
elements = IN[3]

# PREFIXES
str = "@prefix inst: <%s> .\n" % instNS
str+= "@prefix %s: <%s> .\n\n" % (clPFX, clNS)

# INSTANCES
for e in elements:
	str+= "inst:%s a %s .\n" % (e.UniqueId, cl)

OUT = str
# ----------------------------------------

watch = Watch(assign_class)

# group: Write to server
code_block = CodeBlock { "localhost:3000/duplex/opm-upload/class-assignment"; }
post_to_opm_rest = Python(IN[0]=code_block, IN[1]=watch)
# ---------- post_to_opm_rest.python (31 lines) ----------
import sys
sys.path.append('C:\Program Files (x86)\IronPython 2.7\Lib')
import httplib, urllib

# The inputs to this node will be stored as a list in the IN variables.
url = IN[0]
triples = IN[1]

first_slash = url.find('/')
host = url[:first_slash]
route = url[first_slash:]

conn = httplib.HTTPConnection(host)

# Define headers
headers = {"Content-type": "text/turtle", "Accept": "text/plain"}

# Send request
conn.request('POST', route, triples, headers)

# Get response
response = conn.getresponse()

# Read response
data = response.read()

# Close db connection
conn.close()

# Assign your output to the OUT variable.
OUT = data
# ----------------------------------------
watch_2 = Watch(post_to_opm_rest)
