# Dynamo graph class-property-assignment.dyn (Dynamo 2.0.2.6826)

# group: Get element types used in model
# note: NB! Requires the Clockwork package
categories = Categories(index=604)  # graph input
all_elements_of_category = ElementsOfCategory(Category=categories)
elementType = Custom[Element.ElementType+](element=all_elements_of_category)  # Gets the family type of a given element (if applicable). Unlike the OOTB node, it also works for elements in linked models.
uniqueItems = List.UniqueItems(list=elementType)

# group: Get property
code_block = CodeBlock { "Width"; }
getParameterValueByName = Element.GetParameterValueByName(element=uniqueItems, parameterName=code_block)

# group: Generate triples
class_namespace = CodeBlock { "http://localhost:3000/duplex/arch/ontology/"; }
property_namespace = CodeBlock { ["props", "https://w3id.org/props#"]; }
property = CodeBlock { "props:width"; }
datatype_namespace = CodeBlock { ["xsd", "http://www.w3.org/2001/XMLSchema#"]; }
datatype = CodeBlock { "xsd:decimal"; }
# note: [0]Instance namespace
# [1]Property namespace
# [2]Property
# [3]Datatype namespace
# [4]Datatype
# [5]Elements
# [6]Properties
assign_property = Python(IN[0]=class_namespace, IN[1]=property_namespace, IN[2]=property, IN[3]=datatype_namespace, IN[4]=datatype, IN[5]=uniqueItems, IN[6]=getParameterValueByName)
# ---------- assign_property.python (36 lines) ----------
import sys
sys.path.append(r'C:\Program Files (x86)\IronPython 2.7\Lib')
import urllib

#The inputs to this node will be stored as a list in the IN variables.
classNS = IN[0]
propPFX = IN[1][0]
propNS = IN[1][1]
prop = IN[2]
dtPFX = IN[3][0]
dtNS = IN[3][1]
dt = IN[4]
elements = IN[5]
properties = IN[6]

def _get_id_name(e):
	# Make lowercase and replace æ, ø, å
	n = e.Name.lower()
	n = n.replace('æ', 'ae').replace('ø', 'oe').replace('å', 'aa')
	# Make PascalCaseName
	n = ''.join(x for x in n.title() if x.isalnum())
	# URL encode
	n = urllib.quote(n)
	return n

# PREFIXES
str = "@prefix ont: <%s> .\n" % classNS
str+= "@prefix %s: <%s> .\n" % (propPFX, propNS)
str+= "@prefix %s: <%s> .\n\n" % (dtPFX, dtNS)

# INSTANCES
for i, e in enumerate(elements):
	classId = _get_id_name(e)
	str+= 'ont:%s %s "%s"^^%s .\n' % (classId, prop, properties[i], dt)

OUT = str
# ----------------------------------------

watch = Watch(assign_property)

# group: Write to server
code_block_2 = CodeBlock { "localhost:3000/duplex/opm-upload/class-property-assignment"; }
post_to_opm_rest = Python(IN[0]=code_block_2, IN[1]=watch)
# ---------- post_to_opm_rest.python (31 lines) ----------
import sys
sys.path.append('C:\Program Files (x86)\IronPython 2.7\Lib')
import httplib, urllib

# The inputs to this node will be stored as a list in the IN variables.
url = IN[0]
triples = IN[1]

first_slash = url.find('/')
host = url[:first_slash]
route = url[first_slash:]

conn = httplib.HTTPConnection(host)

# Define headers
headers = {"Content-type": "text/turtle", "Accept": "text/plain"}

# Send request
conn.request('POST', route, triples, headers)

# Get response
response = conn.getresponse()

# Read response
data = response.read()

# Close db connection
conn.close()

# Assign your output to the OUT variable.
OUT = data
# ----------------------------------------
watch_2 = Watch(post_to_opm_rest)
