# Dynamo graph property-assignment_OPM-REST.dyn (Dynamo 2.0.2.6826)

# group: Get elements
categories = Categories(index=425)  # graph input
all_elements_of_category = ElementsOfCategory(Category=categories)

# group: Get property
code_block = CodeBlock { "Area"; }
getParameterValueByName = Element.GetParameterValueByName(element=all_elements_of_category, parameterName=code_block)

# group: Generate triples
instance_namespace = CodeBlock { "http://localhost:3000/duplex/arch/spaces/"; }
property_namespace = CodeBlock { ["props", "https://w3id.org/props#"]; }
property = CodeBlock { "props:area"; }
datatype_namespace = CodeBlock { ["xsd", "http://www.w3.org/2001/XMLSchema#"]; }
datatype = CodeBlock { "xsd:decimal"; }
# note: [0]Instance namespace
# [1]Property namespace
# [2]Property
# [3]Datatype namespace
# [4]Datatype
# [5]Elements
# [6]Properties
assign_property = Python(IN[0]=instance_namespace, IN[1]=property_namespace, IN[2]=property, IN[3]=datatype_namespace, IN[4]=datatype, IN[5]=all_elements_of_category, IN[6]=getParameterValueByName)
# ---------- assign_property.python (21 lines) ----------
#The inputs to this node will be stored as a list in the IN variables.
instNS = IN[0]
propPFX = IN[1][0]
propNS = IN[1][1]
prop = IN[2]
dtPFX = IN[3][0]
dtNS = IN[3][1]
dt = IN[4]
elements = IN[5]
properties = IN[6]

# PREFIXES
str = "@prefix inst: <%s> .\n" % instNS
str+= "@prefix %s: <%s> .\n" % (propPFX, propNS)
str+= "@prefix %s: <%s> .\n\n" % (dtPFX, dtNS)

# INSTANCES
for i, e in enumerate(elements):
	str+= 'inst:%s %s "%s"^^%s .\n' % (e.UniqueId, prop, properties[i], dt)

OUT = str
# ----------------------------------------

watch = Watch(assign_property)

# group: Write to server
code_block_2 = CodeBlock { "localhost:3000/duplex/opm-upload/property-assignment"; }
post_to_opm_rest = Python(IN[0]=code_block_2, IN[1]=watch)
# ---------- post_to_opm_rest.python (31 lines) ----------
import sys
sys.path.append('C:\Program Files (x86)\IronPython 2.7\Lib')
import httplib, urllib

# The inputs to this node will be stored as a list in the IN variables.
url = IN[0]
triples = IN[1]

first_slash = url.find('/')
host = url[:first_slash]
route = url[first_slash:]

conn = httplib.HTTPConnection(host)

# Define headers
headers = {"Content-type": "text/turtle", "Accept": "text/plain"}

# Send request
conn.request('POST', route, triples, headers)

# Get response
response = conn.getresponse()

# Read response
data = response.read()

# Close db connection
conn.close()

# Assign your output to the OUT variable.
OUT = data
# ----------------------------------------
watch_2 = Watch(post_to_opm_rest)
