# Dynamo graph space-adjacency_OPM-REST.dyn (Dynamo 2.0.2.6826)

# group: Get relationships
categories = Categories(index=425)  # graph input
all_elements_of_category = ElementsOfCategory(Category=categories)
code_block = CodeBlock { 0.7; }
getSurroundingElements = Custom[Tool.GetSurroundingElements](Element=all_elements_of_category, ElementCheck=all_elements_of_category, Tolerance=code_block)  # Get Surrounding Elements by Categories, group them as List. Tolerance distance available.

# group: Generate triples
code_block_2 = CodeBlock { "http://localhost:3000/duplex/arch/spaces/"; }
# note: [0] Instance namespace
# [1] Relationships
python_script = Python(IN[0]=code_block_2, IN[1]=getSurroundingElements)
# ---------- python_script.python (20 lines) ----------
instNS =		IN[0]	# Namespace to be used for each class instance (ex http://someArchitect/projA/)
adjacencies = 	IN[1]	# List of adjacencies

# PREFIXES
str = "@prefix inst: <%s> .\n" % instNS
str+= "@prefix bot: <https://w3id.org/bot#> .\n\n"

for adjSpaces in adjacencies:
	guidA = adjSpaces[0].UniqueId
	
	adjSet = set()
	for space in adjSpaces:
		if space != adjSpaces[0] and space not in adjSet:
			guidB = space.UniqueId
			
			str+= 'inst:%s bot:adjacentZone inst:%s .\n' % (guidA, guidB)
			adjSet.add(space)

#Assign your output to the OUT variable.
OUT = str
# ----------------------------------------

watch = Watch(python_script)

# group: Write to file
file_path = Filename("..\..\..\..\..\Downloads\test.ttl")
writeText = FileSystem.WriteText(filePath=file_path, text=watch)
