# Dynamo graph space-boundaries-WKT.dyn (Dynamo 2.0.2.6826)

# group: Get spaces
categories = Categories(index=416)  # graph input
all_elements_of_category = ElementsOfCategory(Category=categories)

# group: Get space boundaries as WKT polygons
boundaries = Custom[Room.Boundaries](room=all_elements_of_category)  # Gets a list of all boundaries of a given room or area and a corresponding list of the elements that are generating those boundaries.
# note: Convert to WKT polygons
python_script = Python(IN[0]=boundaries.curves)
# ---------- python_script.python (43 lines) ----------
import clr
clr.AddReference('ProtoGeometry')
from Autodesk.DesignScript.Geometry import *
#The inputs to this node will be stored as a list in the IN variables.
rooms = IN[0]

def linesToWKT(lines):
	wkt = "POLYGON(("
	length = len(lines)
	
	for i,line in enumerate(lines):
		sp = line.StartPoint
		ep = line.EndPoint
		if i == 0 or isEnd:
			# Save startpoint as the polygon starting point
			polyStart = "%s %s" % (str(sp.X), str(sp.Y))
			wkt+= "%s %s, " % (str(sp.X), str(sp.Y))

			
		# Append line endpoint	
		wkt+= "%s %s" % (str(ep.X), str(ep.Y))
		
		# If the endpoint meets the start point, the sub-polygon ends
		isEnd = polyStart == "%s %s" % (str(ep.X), str(ep.Y))
		if isEnd and not i == length-1:
			wkt+= "), ("
		# If last line in list, the whole polygon ends
		elif i == length-1:
			wkt+= "))"
		# If none of above, a new polygon point will come
		else:
			wkt+= ", "
			
	return wkt

polygons = []

for lines in rooms:
	wkt = linesToWKT(lines)
	polygons.append(wkt)

#Assign your output to the OUT variable.
OUT = polygons
# ----------------------------------------

# group: Generate triples
instance_namespace = CodeBlock { "http://localhost:3000/duplex/arch/spaces/"; }
property_namespace = CodeBlock { ["props", "https://w3id.org/props#"]; }
property = CodeBlock { "props:hasSimple2DBoundary"; }
datatype_namespace = CodeBlock { ["geo", "http://www.opengis.net/ont/geosparql#"]; }
datatype = CodeBlock { "geo:wktLiteral"; }
# note: [0]Instance namespace
# [1]Property namespace
# [2]Property
# [3]Datatype namespace
# [4]Datatype
# [5]Elements
# [6]Properties
assign_property = Python(IN[0]=instance_namespace, IN[1]=property_namespace, IN[2]=property, IN[3]=datatype_namespace, IN[4]=datatype, IN[5]=all_elements_of_category, IN[6]=python_script)
# ---------- assign_property.python (21 lines) ----------
#The inputs to this node will be stored as a list in the IN variables.
instNS = IN[0]
propPFX = IN[1][0]
propNS = IN[1][1]
prop = IN[2]
dtPFX = IN[3][0]
dtNS = IN[3][1]
dt = IN[4]
elements = IN[5]
properties = IN[6]

# PREFIXES
str = "@prefix inst: <%s> .\n" % instNS
str+= "@prefix %s: <%s> .\n" % (propPFX, propNS)
str+= "@prefix %s: <%s> .\n\n" % (dtPFX, dtNS)

# INSTANCES
for i, e in enumerate(elements):
	str+= 'inst:%s %s "%s"^^%s .\n' % (e.UniqueId, prop, properties[i], dt)

OUT = str
# ----------------------------------------

watch = Watch(assign_property)

# group: Write to file
file_path = Filename("..\..\..\..\..\Downloads\test.ttl")
writeText = FileSystem.WriteText(filePath=file_path, text=watch)
