# Dynamo graph space-element-adjacency.dyn (Dynamo 2.0.2.6826)

code_block = CodeBlock { "http://localhost:3000/duplex/arch/windows/"; }

# group: Get relationships
categories = Categories(index=416)  # graph input
all_elements_of_category = ElementsOfCategory(Category=categories)
categories_2 = Categories(index=603)  # graph input
all_elements_of_category_2 = ElementsOfCategory(Category=categories_2)
code_block_2 = CodeBlock { 0.7; }
getSurroundingElements = Custom[Tool.GetSurroundingElements](Element=all_elements_of_category, ElementCheck=all_elements_of_category_2, Tolerance=code_block_2)  # Get Surrounding Elements by Categories, group them as List. Tolerance distance available.

# group: Generate triples
code_block_3 = CodeBlock { "http://localhost:3000/duplex/arch/spaces/"; }
# note: [0] Subject namespace
# [1] Object namespace
# [2] Relationships
python_script = Python(IN[0]=code_block_3, IN[1]=code_block, IN[2]=getSurroundingElements)
# ---------- python_script.python (22 lines) ----------
spaceNS =		IN[0]	# Namespace to be used for space (ex http://someArchitect/projA/spaces/)
elementNS =		IN[1]	# Namespace to be used for element (ex http://someArchitect/projA/doors/)
adjacencies = 	IN[2]	# List of adjacencies

# PREFIXES
str = "@prefix sp: <%s> .\n" % spaceNS
str+= "@prefix el: <%s> .\n" % elementNS
str+= "@prefix bot: <https://w3id.org/bot#> .\n\n"

for spaces in adjacencies:
	spaceGUID = spaces[0].UniqueId
	
	adjSet = set()
	for adjElement in spaces:
		if adjElement != spaces[0] and adjElement not in adjSet:
			elementGUID = adjElement.UniqueId
			
			str+= 'sp:%s bot:adjacentElement el:%s .\n' % (spaceGUID, elementGUID)
			adjSet.add(adjElement)

#Assign your output to the OUT variable.
OUT = str
# ----------------------------------------

watch = Watch(python_script)

# group: Write to file
file_path = Filename("..\..\..\..\..\Downloads\test.ttl")
writeText = FileSystem.WriteText(filePath=file_path, text=watch)
