# Dynamo graph space-storey.dyn (Dynamo 2.0.2.6826)

storey_namespace = CodeBlock { "http://localhost:3000/duplex/arch/levels/"; }

# group: Get spaces
# note: NB! Depends on package Archi-lab
categories = Categories(index=416)  # graph input
all_elements_of_category = ElementsOfCategory(Category=categories)

# group: Get storey
code_block = CodeBlock { "ROOM_LEVEL_ID"; }
get_built_in_parameter = Custom[Get Built In Parameter](ParameterNames=code_block, Elements=all_elements_of_category)  # This node will take an input of a built in parameter name and element to return that parameters value.

# group: Generate triples
space_namespace = CodeBlock { "http://localhost:3000/duplex/arch/spaces/"; }
# note: [0] Space namespace
# [1] Storey namespace
# [2] Spaces
# [3] Storeys
assign_property = Python(IN[0]=space_namespace, IN[1]=storey_namespace, IN[2]=all_elements_of_category, IN[3]=get_built_in_parameter)
# ---------- assign_property.python (17 lines) ----------
#The inputs to this node will be stored as a list in the IN variables.
spaceNS = 	IN[0]	# Namespace to be used for each space (ex http://someArchitect/projA/spaces/)
storeyNS = 	IN[1]	# Namespace to be used for each storey (ex http://someArchitect/projA/levels/)
spaces = 	IN[2]	# List of spaces
storeys = 	IN[3]	# List of storeys

# PREFIXES
str = "@prefix bot: <https://w3id.org/bot#> .\n"
str+= "@prefix sp: <%s> .\n" % spaceNS
str+= "@prefix st: <%s> .\n\n" % storeyNS

# INSTANCES
for i, storey in enumerate(storeys):
	space = spaces[i]
	str+= 'st:%s bot:hasSpace sp:%s .\n' % (storey.UniqueId, space.UniqueId)

OUT = str
# ----------------------------------------

watch = Watch(assign_property)

# group: Write to file
file_path = Filename("..\..\..\..\..\Downloads\test.ttl")
writeText = FileSystem.WriteText(filePath=file_path, text=watch)
